# Grasshopper definition floorplan.gh (Grasshopper 1.0.8)

# ---- group: Walls
wall_thickness = Slider(200, range=100..1000)
height = Slider(10000, range=1000..20000)
width = Slider(20000, range=1000..30000)
outer_wall = Rectangle(Plane=PlaneXY(0, 0, 0), XSize=width, YSize=height, Radius=0)  # -> Rectangle, Length
neg = Negative(Value=wall_thickness)
inner_wall = OffsetCurve(Curve=outer_wall.Rectangle, Distance=neg, Corners=1)

# ----
walls = Curve([outer_wall.Rectangle, inner_wall])

# ---- group: Vertical Division
vertical_division = Slider(8000, range=1000..20000)
addition = Addition(A=vertical_division, B=wall_thickness)
p1_start = ConstructPoint(XCoordinate=vertical_division, YCoordinate=wall_thickness, ZCoordinate=0)
subtraction = Subtraction(A=height, B=wall_thickness)
p2_end = ConstructPoint(XCoordinate=addition, YCoordinate=subtraction, ZCoordinate=0)
p2_start = ConstructPoint(XCoordinate=addition, YCoordinate=wall_thickness, ZCoordinate=0)
p1_end = ConstructPoint(XCoordinate=vertical_division, YCoordinate=subtraction, ZCoordinate=0)
vertical_line_2 = Line(StartPoint=p2_start, EndPoint=p2_end)
vertical_line_1 = Line(StartPoint=p1_start, EndPoint=p1_end)

# ----
vertical_division_2 = Curve([vertical_line_1, vertical_line_2])

# ---- group: Horizontal Division
division = Division(A=height, B="2")
division_2 = Division(A=wall_thickness, B="2")
subtraction_2 = Subtraction(A=width, B=wall_thickness)
subtraction_3 = Subtraction(A=division, B=division_2)
addition_2 = Addition(A=division, B=division_2)
h1_end = ConstructPoint(XCoordinate=subtraction_2, YCoordinate=subtraction_3, ZCoordinate=0)
h1_start = ConstructPoint(XCoordinate=addition, YCoordinate=subtraction_3, ZCoordinate=0)
h2_end = ConstructPoint(XCoordinate=subtraction_2, YCoordinate=addition_2, ZCoordinate=0)
h2_start = ConstructPoint(XCoordinate=addition, YCoordinate=addition_2, ZCoordinate=0)
horizontal_line_1 = Line(StartPoint=h1_start, EndPoint=h1_end)
horizontal_line_2 = Line(StartPoint=h2_start, EndPoint=h2_end)

# ----
floor_plan = Curve([outer_wall.Rectangle, inner_wall, vertical_line_1, vertical_line_2, horizontal_line_1, horizontal_line_2])
